# Grasshopper definition planning-with-moveit.gh (Grasshopper 1.0.7)

point = Point(Point(-0.00088, -0.00409, 0.11776))

# ---- group: IAAC Setup
geometry = Geometry(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)
geometry_2 = Geometry(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)
table = Data(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)
legs = Data(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)
plate = Data(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)
kinect_collision = Data(geometry)
kinect = Geometry(geometry_2)

# ----
xy_plane = XYPlane(Origin=point)
ros_connect = ROSConnect(connect=Toggle(True))  # -> ros_client, is_connected; inputs port: Int32, connect: Boolean
#   port ip: The ip address ROS. Defaults to 127.0.0.1.
#   port port: The port of ROS. Defaults to 9090.
#   port connect: If True, connects to ROS. If False, disconnects from ROS. Defaults to False.
#   port ros_client: The ROS client.
#   port is_connected: True if connection established.
# ---------- ros_connect: Python ----------
"""
Connect or disconnect to ROS.

COMPAS FAB v0.28.0
"""
from ghpythonlib.componentbase import executingcomponent as component
from scriptcontext import sticky as st

from compas_fab.backends import RosClient
from compas_fab.ghpython.components import create_id


class ROSConnect(component):
    def RunScript(self, ip, port, connect):
        ros_client = None

        ip = ip or "127.0.0.1"
        port = port or 9090

        key = create_id(self, "ros_client")
        ros_client = st.get(key, None)

        if ros_client:
            st[key].close()
        if connect:
            st[key] = RosClient(ip, port)
            st[key].run(5)

        ros_client = st.get(key, None)
        is_connected = ros_client.is_connected if ros_client else False
        return (ros_client, is_connected)
# ---------- end ros_connect ----------
ros_robot = ROSRobot(ros_client=ros_connect.ros_client, load=Toggle(True))  # -> robot; inputs load: Boolean
#   port ros_client: The ROS client.
#   port load: If True, loads the robot from ROS. Defaults to False.
# ---------- ros_robot: Python ----------
"""
Load robot directly from ROS.

COMPAS FAB v0.28.0
"""
from compas_ghpython.artists import RobotModelArtist
from ghpythonlib.componentbase import executingcomponent as component
from scriptcontext import sticky as st

from compas_fab.ghpython.components import create_id


class ROSRobot(component):
    def RunScript(self, ros_client, load):
        key = create_id(self, "robot")

        if ros_client and ros_client.is_connected and load:
            # Load URDF from ROS
            st[key] = ros_client.load_robot(load_geometry=True, precision="12f")
            st[key].artist = RobotModelArtist(st[key].model)

        robot = st.get(key, None)
        if robot:  # client sometimes need to be restarted, without needing to reload geometry
            robot.client = ros_client
        return robot
# ---------- end ros_robot ----------
attached_tool = AttachedTool(robot=ros_robot, visual_mesh=kinect, collision_mesh=kinect_collision, tcf_plane=xy_plane)  # -> robot; inputs visual_mesh: Mesh, collision_mesh: Mesh
#   port visual_mesh: A visual mesh for the tool.
#   port collision_mesh: A collision mesh for the tool.
#   port tcf_plane: The frame of the tool in tool0 frame.
#   port group: The planning group to which the tool should be attached.
# ---------- attached_tool: Python ----------
"""
Attach a tool to the robot.

COMPAS FAB v0.28.0
"""
from ghpythonlib.componentbase import executingcomponent as component
from compas_rhino.conversions import RhinoMesh
from compas_rhino.conversions import plane_to_compas_frame

from compas.geometry import Frame
from compas_fab.robots import Tool


class AttachToolComponent(component):
    def RunScript(self, robot, visual_mesh, collision_mesh, tcf_plane, group):
        if robot and robot.client and robot.client.is_connected and visual_mesh:
            if not collision_mesh:
                collision_mesh = visual_mesh

            c_visual_mesh = RhinoMesh.from_geometry(visual_mesh).to_compas()
            c_collision_mesh = RhinoMesh.from_geometry(collision_mesh).to_compas()

            if not tcf_plane:
                frame = Frame.worldXY()
            else:
                frame = plane_to_compas_frame(tcf_plane)
            tool = Tool(c_visual_mesh, frame, c_collision_mesh)

            robot.attach_tool(tool, group)

        return robot
# ---------- end attached_tool ----------
planning_scene = PlanningScene(robot=attached_tool)  # -> scene
#   port scene: A planning scene.
# ---------- planning_scene: Python ----------
"""
Create a planning scene.

COMPAS FAB v0.28.0
"""
from ghpythonlib.componentbase import executingcomponent as component
from scriptcontext import sticky as st

from compas_fab.ghpython.components import create_id
from compas_fab.robots import PlanningScene


class PlanningSceneComponent(component):
    def RunScript(self, robot):
        key = create_id(self, "planning_scene")
        if robot:
            st[key] = PlanningScene(robot)
        return st.get(key, None)
# ---------- end planning_scene ----------
collision_mesh = CollisionMesh(scene=planning_scene, mesh=table, identifier="table", add=Button())  # -> ok; inputs mesh: Mesh, add: Boolean, append: Boolean, remove: Boolean
#   port scene: The planning scene.
#   port mesh: A collision mesh.
#   port identifier: The identifier of the collision mesh.
#   port add: If True, adds the collision mesh to the planning scene.
#   port append: If True, appends the collision mesh to the planning scene.
#   port remove: If True, removes the collision mesh from the planning scene.
#   port ok: True if the operation was successfully performed.
# ---------- collision_mesh: Python ----------
"""
Add or remove a collision mesh from the planning scene.

COMPAS FAB v0.28.0
"""
from compas_rhino.geometry import RhinoMesh
from ghpythonlib.componentbase import executingcomponent as component

from compas_fab.robots import CollisionMesh


class CollisionMeshComponent(component):
    def RunScript(self, scene, M, name, add, append, remove):
        ok = False
        self.Message = ""

        if (add and append) or (append and remove) or (add and remove):
            self.Message = "Use only one operation at a time\n(add, append or remove)"
            raise Exception(self.Message)

        if scene and M and name:
            mesh = RhinoMesh.from_geometry(M).to_compas()
            collision_mesh = CollisionMesh(mesh, name)
            if add:
                scene.add_collision_mesh(collision_mesh)
                self.Message = "Added"
                ok = True
            if append:
                scene.append_collision_mesh(collision_mesh)
                self.Message = "Appended"
                ok = True
            if remove:
                scene.remove_collision_mesh(name)
                self.Message = "Removed"
                ok = True
        return ok
# ---------- end collision_mesh ----------
collision_mesh_2 = CollisionMesh(scene=planning_scene, mesh=legs, identifier="legs", add=Button())  # -> ok; inputs mesh: Mesh, add: Boolean, append: Boolean, remove: Boolean; same code as collision_mesh
collision_mesh_3 = CollisionMesh(scene=planning_scene, mesh=plate, identifier="plate", add=Button())  # -> ok; inputs mesh: Mesh, add: Boolean, append: Boolean, remove: Boolean; same code as collision_mesh

# ---- group: PICK
pick_point = Panel("{-0.842136, 0.225104, 0.213039}")
button = Button()
unit_z = UnitZ(Factor="0.15")
curve = Curve(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)
divide_curve = DivideCurve(Curve=curve, Count=10, Kinks=False)  # -> Points, Tangents, Parameters
point_2 = Point(pick_point)
move = Move(Geometry=point_2, Motion=unit_z)  # -> Geometry, Transform
approach = Panel(move.Geometry)
point_3 = Point(move.Geometry)
point_4 = Point([approach, point_2, point_3])
xy_plane_2 = XYPlane(Origin=point_4)
flip_plane = FlipPlane(Plane=xy_plane_2, ReverseX=False, ReverseY=False, SwapAxes=True)
inverse_kinematics = InverseKinematics(robot=attached_tool, plane=flip_plane)  # -> configuration
#   port plane: The plane or frame to calculate the inverse kinematic for.
#   port start_configuration: If passed, calculates the inverse such that the joint positions differ the least from the start_configuration. Defaults to the zero configuration.
#   port group: The planning group used for calculation. Defaults to the robot's main planning group.
#   port configuration: The planning group's configuration.
# ---------- inverse_kinematics: Python ----------
"""
Calculate the robot's inverse kinematic for a given plane.

COMPAS FAB v0.28.0
"""
from compas_rhino.conversions import RhinoPlane
from ghpythonlib.componentbase import executingcomponent as component


class InverseKinematics(component):
    def RunScript(self, robot, plane, start_configuration, group):
        configuration = None
        if robot and robot.client and robot.client.is_connected and plane:
            frame = RhinoPlane.from_geometry(plane).to_compas_frame()
            configuration = robot.inverse_kinematics(frame, start_configuration, group)
        return configuration
# ---------- end inverse_kinematics ----------
panel = Panel(point_4)
list_item = ListItem(List=inverse_kinematics, Index=Slider(0, range=0..11), Wrap=True)
plan_cartesian_motion = PlanCartesianMotion(robot=attached_tool, planes=flip_plane, start_configuration=list_item, compute=button)  # -> trajectory; inputs planes: list, attached_collision_meshes: list, path_constraints: list, compute: Boolean
#   port planes: The planes or frames through which the path is defined.
#   port start_configuration: The robot's full configuration, i.e. values for all configurable joints of the entire robot, at the starting position. Defaults to the all-zero configuration.
#   port group: The planning group used for calculation. Defaults to the robot's main planning group.
#   port attached_collision_meshes: A list of attached collision meshes to be included for planning.
#   port path_constraints: Optional constraints that can be imposed along the solution path. Note that path calculation won't work if the start_configuration violates these constraints. Defaults to None.
#   port max_step: The approximate distance between the calculated points. (Defined in the robot's units.) Defaults to 0.01.
#   port compute: If True, calculates a trajectory.
#   port trajectory: The calculated trajectory.
# ---------- plan_cartesian_motion: Python ----------
"""
Calculate a cartesian motion path (linear in tool space).

COMPAS FAB v0.28.0
"""
from compas_rhino.conversions import RhinoPlane
from ghpythonlib.componentbase import executingcomponent as component
from scriptcontext import sticky as st

from compas_fab.ghpython.components import create_id


class PlanCartesianMotion(component):
    def RunScript(
        self, robot, planes, start_configuration, group, attached_collision_meshes, path_constraints, max_step, compute
    ):
        key = create_id(self, "trajectory")

        max_step = float(max_step) if max_step else 0.01
        path_constraints = list(path_constraints) if path_constraints else None
        attached_collision_meshes = list(attached_collision_meshes) if attached_collision_meshes else None

        if robot and robot.client and robot.client.is_connected and start_configuration and planes and compute:
            frames = [RhinoPlane.from_geometry(plane).to_compas_frame() for plane in planes]
            st[key] = robot.plan_cartesian_motion(
                frames,
                start_configuration=start_configuration,
                group=group,
                options=dict(
                    max_step=max_step,
                    path_constraints=path_constraints,
                    attached_collision_meshes=attached_collision_meshes,
                ),
            )

        trajectory = st.get(key, None)
        return trajectory
# ---------- end plan_cartesian_motion ----------

# ---- group: PLACE
pick_point_2 = Panel("{-0.331806, -0.622655, 0.213039}")
button_2 = Button()
unit_z_2 = UnitZ(Factor="0.15")
point_5 = Point(pick_point_2)
move_2 = Move(Geometry=point_5, Motion=unit_z_2)  # -> Geometry, Transform
approach_2 = Panel(move_2.Geometry)
point_6 = Point(move_2.Geometry)
point_7 = Point([approach_2, point_5, point_6])
xy_plane_3 = XYPlane(Origin=point_7)
flip_plane_2 = FlipPlane(Plane=xy_plane_3, ReverseX=False, ReverseY=False, SwapAxes=True)
inverse_kinematics_2 = InverseKinematics(robot=attached_tool, plane=flip_plane_2)  # -> configuration; same code as inverse_kinematics
panel_2 = Panel(point_7)
list_item_2 = ListItem(List=inverse_kinematics_2, Index=Slider(0, range=0..11), Wrap=True)
plan_cartesian_motion_2 = PlanCartesianMotion(robot=attached_tool, planes=flip_plane_2, start_configuration=list_item_2, compute=button_2)  # -> trajectory; inputs planes: list, attached_collision_meshes: list, path_constraints: list, compute: Boolean; same code as plan_cartesian_motion

# ----
scan_point = Panel("{0.653462, -0.557586, 0.213039}")
point_8 = Point(scan_point)

# ---- group: SCAN
button_3 = Button()
xy_plane_4 = XYPlane(Origin=point_8)
flip_plane_3 = FlipPlane(Plane=xy_plane_4, ReverseX=False, ReverseY=False, SwapAxes=True)
inverse_kinematics_3 = InverseKinematics(robot=attached_tool, plane=flip_plane_3)  # -> configuration; same code as inverse_kinematics
list_item_3 = ListItem(List=inverse_kinematics_3, Index=Slider(0, range=0..11), Wrap=True)
plan_cartesian_motion_3 = PlanCartesianMotion(robot=attached_tool, planes=flip_plane_3, start_configuration=list_item_3, compute=button_3)  # -> trajectory; inputs planes: list, attached_collision_meshes: list, path_constraints: list, compute: Boolean; same code as plan_cartesian_motion

# ----
place_point = Panel("{-0.331806, -0.622655, 0.213039}")
point_9 = Point(place_point)

# ---- group: PICK / Send trajectory
button_4 = Button()
blend = Slider(0.001, range=0.001..0.1)
move_to_config = GhPythonScript(
    trajectory=plan_cartesian_motion,
    speed=Slider(0.24, range=0..2),
    accel=Slider(0.1, range=0..3.14),
    blend=blend,
    send=button,
    ip="127.0.0.1")  # -> a
# ---------- move_to_config: Python ----------
import os
import math

from compas.rpc import Proxy

if send:
    if not trajectory:
        ghenv.Component.Message = "No trajectory to move to!"
    else:
        canvas = ghenv.Component.OnPingDocument()
        path = os.path.abspath(os.path.dirname(canvas.FilePath))
        rtde = Proxy('fabrication', path=path)
        a = rtde.move_trajectory(trajectory.points, speed, accel, blend, ip=ip)
        ghenv.Component.Message = "Sent trajectory"
# ---------- end move_to_config ----------

# ---- group: PLACE / Send trajectory
button_5 = Button()
blend_2 = Slider(0.001, range=0.001..0.1)
move_to_config_2 = GhPythonScript(
    trajectory=plan_cartesian_motion_2,
    speed=Slider(0.24, range=0..2),
    accel=Slider(0.1, range=0..3.14),
    blend=blend_2,
    send=button_2,
    ip="127.0.0.1")  # -> a; same code as move_to_config

# ---- group: SCAN / Send trajectory
button_6 = Button()
blend_3 = Slider(0.001, range=0.001..0.1)
move_to_config_3 = GhPythonScript(
    trajectory=plan_cartesian_motion_3,
    speed=Slider(0.24, range=0..2),
    accel=Slider(0.1, range=0..3.14),
    blend=blend_3,
    send=button_3,
    ip="127.0.0.1")  # -> a; same code as move_to_config

# ---- group: Visualization
trajectory_visualize = TrajectoryVisualize(robot=ros_robot, trajectory=plan_cartesian_motion)  # -> start_configuration, configurations, fraction, time, planes, P, V, A
#   port group: The planning group for which this trajectory was planned.
#   port trajectory: The calculated trajectory.
#   port start_configuration: The start configuration of the trajectory.
#   port configurations: The full configurations along the trajectory.
#   port fraction: Indicates the fraction of requested trajectory that was calculated, e.g. 1 means the full trajectory was found.
#   port time: The time which is needed to execute that trajectory at full speed.
#   port planes: The planes of the robot's end-effector.
#   port P: The positions along the trajectory
#   port V: The velocities along the trajectory
#   port A: The accelerations along the trajectory
# ---------- trajectory_visualize: Python ----------
"""
Visualizes a trajectory.

COMPAS FAB v0.28.0
"""
from compas_ghpython import draw_frame
from compas_ghpython import list_to_ghtree
from ghpythonlib.componentbase import executingcomponent as component


class TrajectoryVisualize(component):
    def RunScript(self, robot, group, trajectory):
        start_configuration = None
        configurations = []
        fraction = 0.0
        time = 0.0

        planes = []
        positions = []
        velocities = []
        accelerations = []

        if robot and trajectory:
            group = group or robot.main_group_name

            for c in trajectory.points:
                configurations.append(
                    robot.merge_group_with_full_configuration(c, trajectory.start_configuration, group)
                )
                frame = robot.forward_kinematics(c, group, options=dict(solver="model"))
                planes.append(draw_frame(frame))
                positions.append(c.positions)
                velocities.append(c.velocities)
                accelerations.append(c.accelerations)

            start_configuration = trajectory.start_configuration
            fraction = trajectory.fraction
            time = trajectory.time_from_start

        P = list_to_ghtree(list(zip(*positions)))
        V = list_to_ghtree(list(zip(*velocities)))
        A = list_to_ghtree(list(zip(*accelerations)))

        # return outputs if you have them; here I try it for you:
        return (start_configuration, configurations, fraction, time, planes, P, V, A)
# ---------- end trajectory_visualize ----------
number_slider = Slider(187, range=0..187)
list_item_4 = ListItem(List=trajectory_visualize.configurations, Index=number_slider, Wrap=True)
list_item_5 = ListItem(List=trajectory_visualize.planes, Index=number_slider, Wrap=True)
robot_visualize = RobotVisualize(robot=ros_robot, configuration=list_item_4)  # -> visual, collision, collision_meshes, attached_meshes, frames, base_frame, ee_frame; inputs show_visual: Boolean, show_collision: Boolean, show_frames: Boolean, show_base_frame: Boolean, show_end_effector_frame: Boolean, show_cm: Boolean, show_acm: Boolean
#   port group: The planning group used for end-effector and base visualization.
#   port configuration: The robot's full configuration.
#   port show_visual: Whether or not to show the robot's visual meshes.
#   port show_collision: Whether or not to show the robot's collision meshes.
#   port show_frames: Whether or not to show the robot's joint frames.
#   port show_base_frame: Whether or not to show the robot's base frame.
#   port show_end_effector_frame: Whether or not to show the robot's end-effector frame.
#   port show_cm: Whether or not to show the collision meshes (if any).
#   port show_acm: Whether or not to show the attached collision meshes (if any).
#   port visual: Rhino meshes of the robot's visual geometry (if any).
#   port collision: Rhino meshes of the robot's collision geometry (if any).
#   port collision_meshes: Rhino meshes of the scene's collision meshes (if any).
#   port attached_meshes: Rhino meshes of the scene's attached collision meshes (if any).
#   port frames: The robot's joint frames as Rhino planes (if any).
#   port base_frame: The robot's base frame as a Rhino plane (if any).
#   port ee_frame: The robot's end-effector frame as a Rhino plane (if any).
# ---------- robot_visualize: Python ----------
"""
Visualizes the robot.

COMPAS FAB v0.28.0
"""
import time

from compas.artists import Artist
from compas.geometry import Frame
from compas.geometry import Transformation
from ghpythonlib.componentbase import executingcomponent as component
from scriptcontext import sticky as st

from compas_fab.ghpython.components import create_id
from compas_fab.robots import PlanningScene


class RobotVisualize(component):
    def RunScript(
        self,
        robot,
        group,
        configuration,
        show_visual,
        show_collision,
        show_frames,
        show_base_frame,
        show_end_effector_frame,
        show_cm,
        show_acm,
    ):
        visual = None
        collision = None
        collision_meshes = None
        attached_meshes = None
        frames = None
        base_frame = None
        ee_frame = None

        if robot:
            show_visual = True if show_visual is None else show_visual
            show_cm = True if show_cm is None else show_cm
            show_acm = True if show_acm is None else show_acm
            configuration = configuration or robot.zero_configuration()

            robot.update(configuration, visual=show_visual, collision=show_collision)
            compas_frames = robot.transformed_frames(configuration, group)

            if show_visual:
                visual = robot.artist.draw_visual()

            if show_collision:
                collision = robot.artist.draw_collision()

            if show_base_frame:
                base_compas_frame = compas_frames[0]
                artist = Artist(base_compas_frame)
                base_frame = artist.draw()

            if show_end_effector_frame:
                ee_compas_frame = robot.forward_kinematics(configuration, group, options=dict(solver="model"))
                artist = Artist(ee_compas_frame)
                ee_frame = artist.draw()

            if show_frames:
                frames = []
                for compas_frame in compas_frames[1:]:
                    artist = Artist(compas_frame)
                    frame = artist.draw()
                    frames.append(frame)

            cached_scene_key = create_id(self, "cached_scene")

            if show_cm or show_acm:
                cached_scene = st.get(cached_scene_key)
                if not cached_scene:
                    cached_scene = {"time": 0}

                # expire cache if the component has not been executed in the last 2 seconds
                # this allows to slide through a list of configurations
                # without triggering refreshes of the scene in the middle of it
                if time.time() - cached_scene["time"] > 2:
                    update_scene = True
                else:
                    update_scene = False

                if update_scene:
                    scene = PlanningScene(robot)
                    scene = robot.client.get_planning_scene()

                if update_scene and show_cm:
                    collision_meshes = []

                    for co in scene.world.collision_objects:
                        header = co.header
                        frame_id = header.frame_id
                        cms = co.to_collision_meshes()

                        for cm in cms:
                            if cm.frame != Frame.worldXY():
                                t = Transformation.from_frame(cm.frame)
                                mesh = cm.mesh.transformed(t)
                            else:
                                mesh = cm.mesh

                            collision_meshes.append(Artist(mesh).draw())

                        cached_scene["cm"] = collision_meshes

                collision_meshes = cached_scene.get("cm", [])

                if update_scene and show_acm:
                    attached_meshes = []

                    for aco in scene.robot_state.attached_collision_objects:
                        for acm in aco.to_attached_collision_meshes():
                            frame_id = aco.object["header"]["frame_id"]
                            frame = robot.forward_kinematics(configuration, options=dict(link=frame_id))
                            t = Transformation.from_frame(frame)

                            # Local CM frame
                            if acm.collision_mesh.frame and acm.collision_mesh.frame != Frame.worldXY():
                                t = t * Transformation.from_frame(acm.collision_mesh.frame)

                            mesh = acm.collision_mesh.mesh.transformed(t)

                            attached_meshes.append(Artist(mesh).draw())

                    cached_scene["acm"] = attached_meshes

                attached_meshes = cached_scene.get("acm", [])

                cached_scene["time"] = time.time()
                st[cached_scene_key] = cached_scene

        return (
            visual,
            collision,
            collision_meshes,
            attached_meshes,
            frames,
            base_frame,
            ee_frame,
        )
# ---------- end robot_visualize ----------

# ---- group: Get current config
get_config = GhPythonScript(send=Button(), ip="127.0.0.1")  # -> config
# ---------- get_config: Python ----------
import os
from scriptcontext import sticky as st
from compas.rpc import Proxy

config_key = 'config_{}'.format(str(ghenv.Component.InstanceGuid))

if config_key not in st:
    st[config_key] = None

if send:
    canvas = ghenv.Component.OnPingDocument()
    path = os.path.abspath(os.path.dirname(canvas.FilePath))
    rtde = Proxy('fabrication', path=path)

    st[config_key] = rtde.get_config(ip=ip)



config = st[config_key]
# ---------- end get_config ----------

# ---- group: Send configuration
number_slider_2 = Slider(0.24, range=0..2)  # disabled
number_slider_3 = Slider(0.1, range=0..3.14)  # disabled
button_7 = Button()  # disabled
move_to_config_4 = GhPythonScript(config=list_item, speed=number_slider_2, accel=number_slider_3, send=button_7, ip="127.0.0.1")  # -> a; disabled
# ---------- move_to_config_4: Python ----------
import os
import math

from compas.rpc import Proxy

if send:
    if not config:
        ghenv.Component.Message = "No config to move to!"
    else:
        canvas = ghenv.Component.OnPingDocument()
        path = os.path.abspath(os.path.dirname(canvas.FilePath))
        rtde = Proxy('fabrication', path=path)
        nowait = True
        a = rtde.move_to_joints(config, speed, accel, nowait, ip=ip)
        ghenv.Component.Message = "Sent config"
# ---------- end move_to_config_4 ----------

# ----
boolean_toggle = BooleanToggle(False)
panel_3 = Panel(get_config)
