# Grasshopper definition planning-with-moveit_custom_andres_simulation.gh (Grasshopper 1.0.7)

# ---- group: RECTANGLE
geometry = Geometry(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)

# ---- group: WHITES
geometry_2 = Geometry([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])

# ---- group: BLUES
geometry_3 = Geometry([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])

# ---- group: REDS
geometry_4 = Geometry([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])

# ----
point = Point("-0.6293, 0.4415, -0.0029")
point_2 = Point("-1.1827, -0.5153, -0.0057")
area = Area(Geometry=geometry)  # -> Area, Centroid
point_3 = Point("-0.6195, -0.5153, -0.0049")
point_4 = Point("-1.1986, 0.4304, -0.0014")
average = Average(Input=[point, point_4, point_2, point_3])
xy_plane = XYPlane(Origin=area.Centroid)
point_5 = Point(Point(-0.4983374973, -0.01129660218, 0))
xy_plane_2 = XYPlane(Origin=average)
rotate = Rotate(Geometry=xy_plane_2, Angle=degrees(Slider(90, range=0..270)), Plane=xy_plane_2)  # -> Geometry, Transform
orient = Orient(Geometry=geometry_2, Source=xy_plane, Target=rotate.Geometry)  # -> Geometry, Transform
orient_2 = Orient(Geometry=geometry_4, Source=xy_plane, Target=rotate.Geometry)  # -> Geometry, Transform
orient_3 = Orient(Geometry=geometry_3, Source=xy_plane, Target=rotate.Geometry)  # -> Geometry, Transform
cluster = Cluster(curves=orient.Geometry)  # -> frames, lenghts, curves_2
cluster_2 = Cluster(curves=orient_2.Geometry)  # -> frames, lenghts, curves_2
cluster_3 = Cluster(curves=orient_3.Geometry)  # -> frames, lenghts, curves_2

# ---- group: TEMP_PICK
point_6 = Point(Point(-0.4246197734, 0.09364457807, 0))

# ---- group: WIDTH
panel = Panel(Slider(0.07813, range=0.05..0.1))

# ---- group: COLOR
panel_2 = Panel(Slider(3, range=1..3))

# ----
list_length = ListLength(List=cluster_2.lenghts)
list_length_2 = ListLength(List=cluster_3.lenghts)
list_length_3 = ListLength(List=cluster.lenghts)
panel_3 = Panel("""0.08612
0.07592""")
panel_4 = Panel("""1
2""")
series = Series(Start=list_length_3, Step=1, Count=list_length)
series_2 = Series(Start=0, Step=1, Count=list_length_3)
panel_5 = Panel("-1")
list_item = ListItem(List=series, Index="-1", Wrap=True)
series_3 = Series(Start=expr("x+1", list_item), Step=1, Count=list_length_2)
number = Number([cluster.lenghts, cluster_2.lenghts, cluster_3.lenghts])
insert_items = InsertItems(List=panel_3, Item=panel, Indices="-1", Wrap=True)
insert_items_2 = InsertItems(List=panel_4, Item=panel_2, Indices="-1", Wrap=True)
list_item_2 = ListItem(List=number, Index=series_3, Wrap=True)
list_item_3 = ListItem(List=number, Index=series_2, Wrap=True)
list_item_4 = ListItem(List=number, Index=series, Wrap=True)
plane = Plane([cluster.frames, cluster_2.frames, cluster_3.frames])
panel_6 = Panel(insert_items_2)
panel_7 = Panel(insert_items)
list_item_5 = ListItem(List=panel_6, Index="-1", Wrap=True)
list_item_6 = ListItem(List=panel_7, Index="-1", Wrap=True)
text_fragment = TextFragment(Text=list_item_2, Start=Slider(2, range=0..10), Count=Slider(2, range=0..10))
text_fragment_2 = TextFragment(Text=list_item_3, Start=Slider(2, range=0..10), Count=Slider(2, range=0..10))
text_fragment_3 = TextFragment(Text=list_item_4, Start=Slider(2, range=0..10), Count=Slider(2, range=0..10))
panel_8 = Panel(panel_7)
concatenate = Concatenate(FragmentA="1", FragmentB=text_fragment_2)  # -> simplify(Result)
concatenate_2 = Concatenate(FragmentA="3", FragmentB=text_fragment)  # -> simplify(Result)
concatenate_3 = Concatenate(FragmentA="2", FragmentB=text_fragment_3)  # -> simplify(Result)
panel_9 = Panel(panel_6)
construct_point = ConstructPoint(XCoordinate=0, YCoordinate=0, ZCoordinate=0)
point_7 = Point(Point(-0.00088, -0.00409, 0.11776))
merge = Merge(Data1=concatenate, Data2=concatenate_3, Data3=concatenate_2)  # -> flatten(Result)

# ---- group: IAAC Setup
plate = Data(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)
geometry_5 = Geometry(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)
legs = Data(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)
geometry_6 = Geometry(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)
table = Data(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)
kinect = Geometry(geometry_6)
kinect_collision = Data(geometry_5)

# ----
xy_plane_3 = XYPlane(Origin=point_7)
text_fragment_4 = TextFragment(Text=panel_8, Start=Slider(2, range=0..10), Count=Slider(2, range=0..10))
panel_10 = Panel(merge)
concatenate_4 = Concatenate(FragmentA=panel_9, FragmentB=text_fragment_4)  # -> simplify(Result)
panel_11 = Panel(concatenate_4)
ghpython_script = GhPythonScript(lista=panel_10, numero=panel_11)  # -> out, indexes; inputs lista: list, numero: list
# ---------- ghpython_script: Python ----------
# Input parameters
lista = lista  # Assuming 'lista' is the input list
numero = numero  # Assuming 'numero' is the input list for which we want to find indexes

# Output parameter
indexes = []

for num in numero:
    num_indexes = [i for i, x in enumerate(lista) if x == num and i not in indexes]
    if num_indexes:
        indexes.append(num_indexes[0])  # Append the first index if found

indexes
# ---------- end ghpython_script ----------
ghpython_script_2 = GhPythonScript(x=panel_10, y=panel_11)  # -> out, a; inputs x: list, y: list
# ---------- ghpython_script_2: Python ----------
a = []
values = []

def count_occurrences(lst, element):
    count = 0
    for item in lst:
        if item == element:
            count += 1
    return count

for item in y:
    found_index = None
    for j in range(len(x)):
        if x[j] == item:
            occurrences = count_occurrences(values, item)
            found_index = j + occurrences
            break
    a.append(found_index)
    values.append(item)
# ---------- end ghpython_script_2 ----------

# ---- group: FRAMES
list_item_7 = ListItem(List=plane, Index=ghpython_script_2.a, Wrap=True)

# ----
scan_point = Panel("{0.54566, -0.6935, 0.43118}")
cull_index = CullIndex(List=panel_10, Indices=ghpython_script_2.a, Wrap=True)
list_item_8 = ListItem(List=panel_10, Index=ghpython_script_2.a, Wrap=True)
cull_index_2 = CullIndex(List=plane, Indices=ghpython_script_2.a, Wrap=True)
ros_connect = ROSConnect(connect=Toggle(True))  # -> ros_client, is_connected; inputs port: Int32, connect: Boolean
#   port ip: The ip address ROS. Defaults to 127.0.0.1.
#   port port: The port of ROS. Defaults to 9090.
#   port connect: If True, connects to ROS. If False, disconnects from ROS. Defaults to False.
#   port ros_client: The ROS client.
#   port is_connected: True if connection established.
# ---------- ros_connect: Python ----------
"""
Connect or disconnect to ROS.

COMPAS FAB v0.28.0
"""
from ghpythonlib.componentbase import executingcomponent as component
from scriptcontext import sticky as st

from compas_fab.backends import RosClient
from compas_fab.ghpython.components import create_id


class ROSConnect(component):
    def RunScript(self, ip, port, connect):
        ros_client = None

        ip = ip or "127.0.0.1"
        port = port or 9090

        key = create_id(self, "ros_client")
        ros_client = st.get(key, None)

        if ros_client:
            st[key].close()
        if connect:
            st[key] = RosClient(ip, port)
            st[key].run(5)

        ros_client = st.get(key, None)
        is_connected = ros_client.is_connected if ros_client else False
        return (ros_client, is_connected)
# ---------- end ros_connect ----------
subscribe_to_topic = SubscribeToTopic(
    ros_client=ros_connect.ros_client,
    topic_name="/tile_rotation",
    topic_type="std_msgs/String",
    start=Button(),
    stop=Button())  # -> topic, last_msg, is_subscribed; inputs interval: Int32, start: Boolean, stop: Boolean
#   port ros_client: The ROS client.
#   port topic_name: Name of the topic to subscribe to, eg. /joint_states
#   port topic_type: Type of the topic to subscribe to, eg. sensor_msgs/JointState
#   port interval: Interval in milliseconds at which to expire the solution to propagate received messages. Defaults to 25ms. Messages are not queued, so if the interval is greater than the rate at which messages are published, some messages will be dropped.
#   port start: Start receiving messages.
#   port stop: Stop receiving messages.
#   port topic: The subscribed topic instance.
#   port last_msg: The last received message.
#   port is_subscribed: Indicates if the topic is currently subscribed or not.
# ---------- subscribe_to_topic: Python ----------
"""
Subscribe to a ROS topic.

COMPAS FAB v0.28.0
"""
import time

import Grasshopper.Kernel
from ghpythonlib.componentbase import executingcomponent as component
from roslibpy import Topic
from scriptcontext import sticky as st

from compas_fab.backends.ros.messages import ROSmsg
from compas_fab.ghpython.components import create_id


class ROSTopicSubscribe(component):
    def RunScript(self, ros_client, topic_name, topic_type, interval, start, stop):
        if not topic_name:
            raise ValueError("Please specify the name of the topic")
        if not topic_type:
            raise ValueError("Please specify the type of the topic")

        if not hasattr(self, "message_count"):
            self.message_count = 0

        self.interval = interval or 25  # in milliseconds
        self.is_updating = False
        self.is_subscribed = False

        self.msg_key = create_id(self, "last_msg")
        key = create_id(self, "topic")

        last_msg = st.get(self.msg_key, None)
        topic = st.get(key, None)

        if ros_client and ros_client.is_connected:
            if start:
                self._unsubscribe(topic)

                topic = Topic(ros_client, topic_name, topic_type)
                topic.subscribe(self.topic_callback)
                time.sleep(0.2)

                st[key] = topic

            if stop:
                self._unsubscribe(topic)

        self.is_subscribed = topic and topic.is_subscribed

        if last_msg:
            last_msg = ROSmsg.parse(last_msg, topic_type)

        if self.is_subscribed:
            self.Message = "Subscribed, {} messages".format(self.message_count)
        else:
            self.Message = "Not subscribed"

        return (topic, last_msg, self.is_subscribed)

    def _unsubscribe(self, topic):
        if topic and topic.is_subscribed:
            topic.unsubscribe()
            time.sleep(0.2)

    def topic_callback(self, msg):
        self.message_count += 1
        st[self.msg_key] = msg

        if self.is_subscribed:
            ghdoc = ghenv.Component.OnPingDocument()  # noqa: F821 This is defined by Grasshopper
            if not self.is_updating and ghdoc.SolutionState != Grasshopper.Kernel.GH_ProcessStep.Process:
                self.is_updating = True
                ghdoc.ScheduleSolution(
                    self.interval, Grasshopper.Kernel.GH_Document.GH_ScheduleDelegate(self.expire_callback)
                )

    def expire_callback(self, ghdoc):
        if ghdoc.SolutionState != Grasshopper.Kernel.GH_ProcessStep.Process:
            ghenv.Component.ExpireSolution(False)  # noqa: F821 This is defined by Grasshopper
        self.is_updating = False
# ---------- end subscribe_to_topic ----------
subscribe_to_topic_2 = SubscribeToTopic(ros_client=ros_connect.ros_client, topic_name="/tile_width", topic_type="std_msgs/String", start=Button(), stop=Button())  # -> topic, last_msg, is_subscribed; inputs interval: Int32, start: Boolean, stop: Boolean; same code as subscribe_to_topic
subscribe_to_topic_3 = SubscribeToTopic(ros_client=ros_connect.ros_client, topic_name="/tile_color", topic_type="std_msgs/String", start=Button(), stop=Button())  # -> topic, last_msg, is_subscribed; inputs interval: Int32, start: Boolean, stop: Boolean; same code as subscribe_to_topic
subscribe_to_topic_4 = SubscribeToTopic(
    ros_client=ros_connect.ros_client,
    topic_name="/detected_tile",
    topic_type="geometry_msgs/Point",
    start=Button(),
    stop=Button())  # -> topic, last_msg, is_subscribed; inputs interval: Int32, start: Boolean, stop: Boolean; same code as subscribe_to_topic
ghpython_script_3 = GhPythonScript(ros_point=subscribe_to_topic_4.last_msg)  # -> point
# ---------- ghpython_script_3: Python ----------
from compas.geometry import Point

point = Point(ros_point.x, ros_point.y, ros_point.z)
print point
# ---------- end ghpython_script_3 ----------
ghpython_script_4 = GhPythonScript(x=subscribe_to_topic.last_msg)  # -> rotation
# ---------- ghpython_script_4: Python ----------
rotation = x.data
# ---------- end ghpython_script_4 ----------
ghpython_script_5 = GhPythonScript(x=subscribe_to_topic_2.last_msg)  # -> width
# ---------- ghpython_script_5: Python ----------
width = x.data
# ---------- end ghpython_script_5 ----------
ghpython_script_6 = GhPythonScript(x=subscribe_to_topic_3.last_msg)  # -> color
# ---------- ghpython_script_6: Python ----------
color = x.data

if color == "white":
    color = 1
elif color == "red":
    color = 2
elif color == "blue":
    color = 3
# ---------- end ghpython_script_6 ----------
panel_12 = Panel(ghpython_script_4)
draw = Draw(cg=ghpython_script_3)  # -> rg
#   port cg: The COMPAS geometry or datastructure to be drawn.
#   port rg: The Rhino geometry object.
# ---------- draw: Python ----------
"""
Draws COMPAS geometry in Grasshopper.
"""
from ghpythonlib.componentbase import executingcomponent as component

from compas.artists import Artist


class CompasToRhinoGeometry(component):
    def RunScript(self, cg):
        if not cg:
            return None

        return Artist(cg).draw()
# ---------- end draw ----------
panel_13 = Panel(ghpython_script_5)
panel_14 = Panel(ghpython_script_6)
construct_plane = ConstructPlane(Origin=draw, XAxis="0,1,0", YAxis="1,0,0")

# ---- group: FRAME
list_item_9 = ListItem(List=list_item_7, Index="-1", Wrap=True)

# ---- group: Get current config
get_config = GhPythonScript(send=Button(), ip="127.0.0.1")  # -> config
# ---------- get_config: Python ----------
import os
from scriptcontext import sticky as st
from compas.rpc import Proxy

config_key = 'config_{}'.format(str(ghenv.Component.InstanceGuid))

if config_key not in st:
    st[config_key] = None

if send:
    canvas = ghenv.Component.OnPingDocument()
    path = os.path.abspath(os.path.dirname(canvas.FilePath))
    rtde = Proxy('fabrication', path=path)

    st[config_key] = rtde.get_config(ip=ip)



config = st[config_key]
# ---------- end get_config ----------

# ----
point_8 = Point(list_item_9)

# ---- group: TEMP_SCAN
point_9 = Point(Point(-0.4246197734, -0.01644901171, 0.3340908946))

# ----
point_10 = Point(point_9)
ros_robot = ROSRobot(ros_client=ros_connect.ros_client, load=Toggle(True))  # -> robot; inputs load: Boolean
#   port ros_client: The ROS client.
#   port load: If True, loads the robot from ROS. Defaults to False.
# ---------- ros_robot: Python ----------
"""
Load robot directly from ROS.

COMPAS FAB v0.28.0
"""
from compas_ghpython.artists import RobotModelArtist
from ghpythonlib.componentbase import executingcomponent as component
from scriptcontext import sticky as st

from compas_fab.ghpython.components import create_id


class ROSRobot(component):
    def RunScript(self, ros_client, load):
        key = create_id(self, "robot")

        if ros_client and ros_client.is_connected and load:
            # Load URDF from ROS
            st[key] = ros_client.load_robot(load_geometry=True, precision="12f")
            st[key].artist = RobotModelArtist(st[key].model)

        robot = st.get(key, None)
        if robot:  # client sometimes need to be restarted, without needing to reload geometry
            robot.client = ros_client
        return robot
# ---------- end ros_robot ----------
attached_tool = AttachedTool(robot=ros_robot, visual_mesh=kinect, collision_mesh=kinect_collision, tcf_plane=xy_plane_3)  # -> robot; inputs visual_mesh: Mesh, collision_mesh: Mesh
#   port visual_mesh: A visual mesh for the tool.
#   port collision_mesh: A collision mesh for the tool.
#   port tcf_plane: The frame of the tool in tool0 frame.
#   port group: The planning group to which the tool should be attached.
# ---------- attached_tool: Python ----------
"""
Attach a tool to the robot.

COMPAS FAB v0.28.0
"""
from ghpythonlib.componentbase import executingcomponent as component
from compas_rhino.conversions import RhinoMesh
from compas_rhino.conversions import plane_to_compas_frame

from compas.geometry import Frame
from compas_fab.robots import Tool


class AttachToolComponent(component):
    def RunScript(self, robot, visual_mesh, collision_mesh, tcf_plane, group):
        if robot and robot.client and robot.client.is_connected and visual_mesh:
            if not collision_mesh:
                collision_mesh = visual_mesh

            c_visual_mesh = RhinoMesh.from_geometry(visual_mesh).to_compas()
            c_collision_mesh = RhinoMesh.from_geometry(collision_mesh).to_compas()

            if not tcf_plane:
                frame = Frame.worldXY()
            else:
                frame = plane_to_compas_frame(tcf_plane)
            tool = Tool(c_visual_mesh, frame, c_collision_mesh)

            robot.attach_tool(tool, group)

        return robot
# ---------- end attached_tool ----------
planning_scene = PlanningScene(robot=attached_tool)  # -> scene
#   port scene: A planning scene.
# ---------- planning_scene: Python ----------
"""
Create a planning scene.

COMPAS FAB v0.28.0
"""
from ghpythonlib.componentbase import executingcomponent as component
from scriptcontext import sticky as st

from compas_fab.ghpython.components import create_id
from compas_fab.robots import PlanningScene


class PlanningSceneComponent(component):
    def RunScript(self, robot):
        key = create_id(self, "planning_scene")
        if robot:
            st[key] = PlanningScene(robot)
        return st.get(key, None)
# ---------- end planning_scene ----------
collision_mesh = CollisionMesh(scene=planning_scene, mesh=table, identifier="table", add=Button())  # -> ok; inputs mesh: Mesh, add: Boolean, append: Boolean, remove: Boolean
#   port scene: The planning scene.
#   port mesh: A collision mesh.
#   port identifier: The identifier of the collision mesh.
#   port add: If True, adds the collision mesh to the planning scene.
#   port append: If True, appends the collision mesh to the planning scene.
#   port remove: If True, removes the collision mesh from the planning scene.
#   port ok: True if the operation was successfully performed.
# ---------- collision_mesh: Python ----------
"""
Add or remove a collision mesh from the planning scene.

COMPAS FAB v0.28.0
"""
from compas_rhino.geometry import RhinoMesh
from ghpythonlib.componentbase import executingcomponent as component

from compas_fab.robots import CollisionMesh


class CollisionMeshComponent(component):
    def RunScript(self, scene, M, name, add, append, remove):
        ok = False
        self.Message = ""

        if (add and append) or (append and remove) or (add and remove):
            self.Message = "Use only one operation at a time\n(add, append or remove)"
            raise Exception(self.Message)

        if scene and M and name:
            mesh = RhinoMesh.from_geometry(M).to_compas()
            collision_mesh = CollisionMesh(mesh, name)
            if add:
                scene.add_collision_mesh(collision_mesh)
                self.Message = "Added"
                ok = True
            if append:
                scene.append_collision_mesh(collision_mesh)
                self.Message = "Appended"
                ok = True
            if remove:
                scene.remove_collision_mesh(name)
                self.Message = "Removed"
                ok = True
        return ok
# ---------- end collision_mesh ----------
collision_mesh_2 = CollisionMesh(scene=planning_scene, mesh=plate, identifier="plate", add=Button())  # -> ok; inputs mesh: Mesh, add: Boolean, append: Boolean, remove: Boolean; same code as collision_mesh
collision_mesh_3 = CollisionMesh(scene=planning_scene, mesh=legs, identifier="legs", add=Button())  # -> ok; inputs mesh: Mesh, add: Boolean, append: Boolean, remove: Boolean; same code as collision_mesh
panel_15 = Panel(get_config)
scan_point_2 = Panel("{0.653462, -0.557586, 0.213039}")
rotate_2 = Rotate(Geometry=point_10, Angle="0", Plane=PlaneXY(0, 0, 0))  # -> Geometry, Transform
point_11 = Point(point_10)

# ---- group: SCAN
button = Button()
xy_plane_4 = XYPlane(Origin=point_11)
flip_plane = FlipPlane(Plane=xy_plane_4, ReverseX=False, ReverseY=False, SwapAxes=True)
inverse_kinematics = InverseKinematics(robot=attached_tool, plane=flip_plane)  # -> configuration
#   port plane: The plane or frame to calculate the inverse kinematic for.
#   port start_configuration: If passed, calculates the inverse such that the joint positions differ the least from the start_configuration. Defaults to the zero configuration.
#   port group: The planning group used for calculation. Defaults to the robot's main planning group.
#   port configuration: The planning group's configuration.
# ---------- inverse_kinematics: Python ----------
"""
Calculate the robot's inverse kinematic for a given plane.

COMPAS FAB v0.28.0
"""
from compas_rhino.conversions import RhinoPlane
from ghpythonlib.componentbase import executingcomponent as component


class InverseKinematics(component):
    def RunScript(self, robot, plane, start_configuration, group):
        configuration = None
        if robot and robot.client and robot.client.is_connected and plane:
            frame = RhinoPlane.from_geometry(plane).to_compas_frame()
            configuration = robot.inverse_kinematics(frame, start_configuration, group)
        return configuration
# ---------- end inverse_kinematics ----------
list_item_10 = ListItem(List=inverse_kinematics, Index=Slider(0, range=0..11), Wrap=True)
plan_cartesian_motion = PlanCartesianMotion(robot=attached_tool, planes=flip_plane, start_configuration=list_item_10, compute=button)  # -> trajectory; inputs planes: list, attached_collision_meshes: list, path_constraints: list, compute: Boolean
#   port planes: The planes or frames through which the path is defined.
#   port start_configuration: The robot's full configuration, i.e. values for all configurable joints of the entire robot, at the starting position. Defaults to the all-zero configuration.
#   port group: The planning group used for calculation. Defaults to the robot's main planning group.
#   port attached_collision_meshes: A list of attached collision meshes to be included for planning.
#   port path_constraints: Optional constraints that can be imposed along the solution path. Note that path calculation won't work if the start_configuration violates these constraints. Defaults to None.
#   port max_step: The approximate distance between the calculated points. (Defined in the robot's units.) Defaults to 0.01.
#   port compute: If True, calculates a trajectory.
#   port trajectory: The calculated trajectory.
# ---------- plan_cartesian_motion: Python ----------
"""
Calculate a cartesian motion path (linear in tool space).

COMPAS FAB v0.28.0
"""
from compas_rhino.conversions import RhinoPlane
from ghpythonlib.componentbase import executingcomponent as component
from scriptcontext import sticky as st

from compas_fab.ghpython.components import create_id


class PlanCartesianMotion(component):
    def RunScript(
        self, robot, planes, start_configuration, group, attached_collision_meshes, path_constraints, max_step, compute
    ):
        key = create_id(self, "trajectory")

        max_step = float(max_step) if max_step else 0.01
        path_constraints = list(path_constraints) if path_constraints else None
        attached_collision_meshes = list(attached_collision_meshes) if attached_collision_meshes else None

        if robot and robot.client and robot.client.is_connected and start_configuration and planes and compute:
            frames = [RhinoPlane.from_geometry(plane).to_compas_frame() for plane in planes]
            st[key] = robot.plan_cartesian_motion(
                frames,
                start_configuration=start_configuration,
                group=group,
                options=dict(
                    max_step=max_step,
                    path_constraints=path_constraints,
                    attached_collision_meshes=attached_collision_meshes,
                ),
            )

        trajectory = st.get(key, None)
        return trajectory
# ---------- end plan_cartesian_motion ----------

# ---- group: Activate Gripper
blend = Slider(0.001, range=0.001..0.1)
move_to_config = GhPythonScript(speed=Slider(0.24, range=0..2), accel=Slider(0.1, range=0..3.14), blend=blend, send=Button(), ip="127.0.0.1")  # -> a
# ---------- move_to_config: Python ----------
import os
import math

from compas.rpc import Proxy

if send:
    if not trajectory:
        ghenv.Component.Message = "No trajectory to move to!"
    else:
        canvas = ghenv.Component.OnPingDocument()
        path = os.path.abspath(os.path.dirname(canvas.FilePath))
        rtde = Proxy('fabrication', path=path)
        c = rtde.set_tool_digital_io(signal=0, value=True, ip=ip)
        ghenv.Component.Message = "Tool activated"
# ---------- end move_to_config ----------

# ----
panel_16 = Panel("""-0.59411008
-1.2547172
2.15234003
-4.07150408
0.58014744
0.02356194""")
forward_kinematics = ForwardKinematics()  # -> frame; inputs use_only_model: Boolean
#   port config: The configuration to calculate the forward kinematics for.
#   port group: The planning group used for calculation. Defaults to the robot's main planning group.
#   port link: The link name to calculate forward kinematics for. Defaults to the robot's end effector.
#   port use_only_model: If True, use only the robot model instead of the connected backend to calculate FK.
#   port frame: The resulting frame.
# ---------- forward_kinematics: Python ----------
"""
Calculate the robot's forward kinematic for a given configuration.

COMPAS FAB v0.28.0
"""
from ghpythonlib.componentbase import executingcomponent as component


class ForwardKinematics(component):
    def RunScript(self, robot, config, group, link, use_only_model):
        frame = None
        if robot and config:
            options = {}
            if link:
                options["link"] = link
            if use_only_model:
                options["solver"] = "model"
            frame = robot.forward_kinematics(config, group, options=options)
        return frame
# ---------- end forward_kinematics ----------

# ---- group: Deactivate Gripper
blend_2 = Slider(0.001, range=0.001..0.1)
move_to_config_2 = GhPythonScript(speed=Slider(0.24, range=0..2), accel=Slider(0.1, range=0..3.14), blend=blend_2, send=Button(), ip="127.0.0.1")  # -> a
# ---------- move_to_config_2: Python ----------
import os
import math

from compas.rpc import Proxy

if send:
    if not trajectory:
        ghenv.Component.Message = "No trajectory to move to!"
    else:
        canvas = ghenv.Component.OnPingDocument()
        path = os.path.abspath(os.path.dirname(canvas.FilePath))
        rtde = Proxy('fabrication', path=path)
        c = rtde.set_tool_digital_io(signal=0, value=True, ip=ip)
        ghenv.Component.Message = "Tool deactivated"
# ---------- end move_to_config_2 ----------

# ----
zero_config = ZeroConfig(robot=attached_tool)  # -> config
#   port group: If assigned, it will return the zero configuration for the given group, otherwise a full zero configuration.
#   port config: The zero configuration.
# ---------- zero_config: Python ----------
"""
Get a zero configuration for a robot.

COMPAS FAB v0.28.0
"""
from ghpythonlib.componentbase import executingcomponent as component


class ConfigZero(component):
    def RunScript(self, robot, group):
        if robot:
            return robot.zero_configuration(group)

        return None
# ---------- end zero_config ----------
panel_17 = Panel(zero_config)

# ---- group: SCAN / Send trajectory
button_2 = Button()
blend_3 = Slider(0.001, range=0.001..0.1)
move_to_config_3 = GhPythonScript(
    trajectory=plan_cartesian_motion,
    speed=Slider(0.24, range=0..2),
    accel=Slider(0.1, range=0..3.14),
    blend=blend_3,
    send=button,
    ip="127.0.0.1")  # -> a
# ---------- move_to_config_3: Python ----------
import os
import math

from compas.rpc import Proxy

if send:
    if not trajectory:
        ghenv.Component.Message = "No trajectory to move to!"
    else:
        canvas = ghenv.Component.OnPingDocument()
        path = os.path.abspath(os.path.dirname(canvas.FilePath))
        rtde = Proxy('fabrication', path=path)
        a = rtde.move_trajectory(trajectory.points, speed, accel, blend, ip=ip)
        ghenv.Component.Message = "Sent trajectory"
# ---------- end move_to_config_3 ----------

# ---- group: PLACE
place_point = Panel("{-0.331806, -0.622655, 0.213039}")
button_3 = Button()
unit_z = UnitZ(Factor="0.15")
point_12 = Point(flatten(point_8))
move = Move(Geometry=point_12, Motion=unit_z)  # -> Geometry, Transform
approach = Panel(move.Geometry)
point_13 = Point(flatten(move.Geometry))

# ----
line = Line(StartPoint=point_13, EndPoint=point_10)
divide_curve = DivideCurve(Curve=line, Count=10, Kinks=False)  # -> Points, Tangents, Parameters

# ---- group: SCAN
button_4 = Button()
xy_plane_5 = XYPlane(Origin=divide_curve.Points)
flip_plane_2 = FlipPlane(Plane=xy_plane_5, ReverseX=False, ReverseY=False, SwapAxes=True)
inverse_kinematics_2 = InverseKinematics(robot=attached_tool, plane=flip_plane_2)  # -> configuration; same code as inverse_kinematics
list_item_11 = ListItem(List=inverse_kinematics_2, Index=Slider(0, range=0..11), Wrap=True)
plan_cartesian_motion_2 = PlanCartesianMotion(robot=attached_tool, planes=flip_plane_2, start_configuration=list_item_11, compute=button_4)  # -> trajectory; inputs planes: list, attached_collision_meshes: list, path_constraints: list, compute: Boolean; same code as plan_cartesian_motion

# ---- group: SCAN / Send trajectory
button_5 = Button()
blend_4 = Slider(0.001, range=0.001..0.1)
move_to_config_4 = GhPythonScript(
    trajectory=plan_cartesian_motion_2,
    speed=Slider(0.24, range=0..2),
    accel=Slider(0.1, range=0..3.14),
    blend=blend_4,
    send=button_4,
    ip="127.0.0.1")  # -> a; same code as move_to_config_3

# ---- group: PICK
button_6 = Button()
pick_point = Panel("{-0.842136, 0.225104, 0.213039}")
unit_z_2 = UnitZ(Factor="0.15")
point_14 = Point(flatten(point_6))
move_2 = Move(Geometry=point_14, Motion=unit_z_2)  # -> Geometry, Transform
approach_2 = Panel(move_2.Geometry)
point_15 = Point(flatten(move_2.Geometry))

# ----
line_2 = Line(StartPoint=point_10, EndPoint=point_15)
divide_curve_2 = DivideCurve(Curve=line_2, Count=10, Kinks=False)  # -> flatten(Points), Tangents, Parameters
line_3 = Line(StartPoint=point_15, EndPoint=point_13)
merge_2 = Merge(Data1=divide_curve_2.Points, Data2=point_14)
divide_curve_3 = DivideCurve(Curve=line_3, Count=10, Kinks=False)  # -> flatten(Points), Tangents, Parameters
merge_3 = Merge(Data1=divide_curve_3.Points, Data2=point_12)

# ---- group: PLACE (continued)
point_16 = Point(merge_3)
xy_plane_6 = XYPlane(Origin=point_16)
flip_plane_3 = FlipPlane(Plane=xy_plane_6, ReverseX=False, ReverseY=False, SwapAxes=True)
inverse_kinematics_3 = InverseKinematics(robot=attached_tool, plane=flip_plane_3)  # -> configuration; same code as inverse_kinematics
panel_18 = Panel(point_16)
list_item_12 = ListItem(List=inverse_kinematics_3, Index=Slider(0, range=0..11), Wrap=True)
plan_cartesian_motion_3 = PlanCartesianMotion(robot=attached_tool, planes=flip_plane_3, start_configuration=list_item_12, compute=button_3)  # -> trajectory; inputs planes: list, attached_collision_meshes: list, path_constraints: list, compute: Boolean; same code as plan_cartesian_motion

# ---- group: PICK (continued)
point_17 = Point(merge_2)
xy_plane_7 = XYPlane(Origin=point_17)
panel_19 = Panel(point_17)
flip_plane_4 = FlipPlane(Plane=xy_plane_7, ReverseX=False, ReverseY=False, SwapAxes=True)
inverse_kinematics_4 = InverseKinematics(robot=attached_tool, plane=flip_plane_4)  # -> configuration; same code as inverse_kinematics
list_item_13 = ListItem(List=inverse_kinematics_4, Index=Slider(0, range=0..11), Wrap=True)
plan_cartesian_motion_4 = PlanCartesianMotion(robot=attached_tool, planes=flip_plane_4, start_configuration=list_item_13, compute=button_6)  # -> trajectory; inputs planes: list, attached_collision_meshes: list, path_constraints: list, compute: Boolean; same code as plan_cartesian_motion

# ---- group: PICK / Send trajectory
button_7 = Button()
blend_5 = Slider(0.001, range=0.001..0.1)
move_to_config_5 = GhPythonScript(
    trajectory=plan_cartesian_motion_4,
    speed=Slider(0.24, range=0..2),
    accel=Slider(0.1, range=0..3.14),
    blend=blend_5,
    send=button_6,
    ip="127.0.0.1")  # -> a
# ---------- move_to_config_5: Python ----------
import os
import math

from compas.rpc import Proxy

if send:
    if not trajectory:
        ghenv.Component.Message = "No trajectory to move to!"
    else:
        canvas = ghenv.Component.OnPingDocument()
        path = os.path.abspath(os.path.dirname(canvas.FilePath))
        rtde = Proxy('fabrication', path=path)
        a = rtde.move_trajectory(trajectory.points, speed, accel, blend, ip=ip)
        ghenv.Component.Message = "Sent trajectory"
        #b = rtde.move_until_contact(ip=ip)
        #ghenv.Component.Message = "Move until contact done"
        c = rtde.set_tool_digital_io(signal=0, value=True, ip=ip)
        ghenv.Component.Message = "Tool activated"
# ---------- end move_to_config_5 ----------

# ---- group: PLACE / Send trajectory
button_8 = Button()
blend_6 = Slider(0.001, range=0.001..0.1)
move_to_config_6 = GhPythonScript(
    trajectory=plan_cartesian_motion_3,
    speed=Slider(0.24, range=0..2),
    accel=Slider(0.1, range=0..3.14),
    blend=blend_6,
    send=button_3,
    ip="127.0.0.1")  # -> a
# ---------- move_to_config_6: Python ----------
import os
import math

from compas.rpc import Proxy

if send:
    if not trajectory:
        ghenv.Component.Message = "No trajectory to move to!"
    else:
        canvas = ghenv.Component.OnPingDocument()
        path = os.path.abspath(os.path.dirname(canvas.FilePath))
        rtde = Proxy('fabrication', path=path)
        a = rtde.move_trajectory(trajectory.points, speed, accel, blend, ip=ip)
        ghenv.Component.Message = "Sent trajectory"
        #b = rtde.move_until_contact(ip=ip)
        #ghenv.Component.Message = "Move until contact done"
        c = rtde.set_tool_digital_io(signal=0, value=False, ip=ip)
        ghenv.Component.Message = "Tool deactivated"
# ---------- end move_to_config_6 ----------

# ---- group: Visualization
trajectory_visualize = TrajectoryVisualize(robot=ros_robot, trajectory=plan_cartesian_motion_4)  # -> start_configuration, configurations, fraction, time, planes, P, V, A
#   port group: The planning group for which this trajectory was planned.
#   port trajectory: The calculated trajectory.
#   port start_configuration: The start configuration of the trajectory.
#   port configurations: The full configurations along the trajectory.
#   port fraction: Indicates the fraction of requested trajectory that was calculated, e.g. 1 means the full trajectory was found.
#   port time: The time which is needed to execute that trajectory at full speed.
#   port planes: The planes of the robot's end-effector.
#   port P: The positions along the trajectory
#   port V: The velocities along the trajectory
#   port A: The accelerations along the trajectory
# ---------- trajectory_visualize: Python ----------
"""
Visualizes a trajectory.

COMPAS FAB v0.28.0
"""
from compas_ghpython import draw_frame
from compas_ghpython import list_to_ghtree
from ghpythonlib.componentbase import executingcomponent as component


class TrajectoryVisualize(component):
    def RunScript(self, robot, group, trajectory):
        start_configuration = None
        configurations = []
        fraction = 0.0
        time = 0.0

        planes = []
        positions = []
        velocities = []
        accelerations = []

        if robot and trajectory:
            group = group or robot.main_group_name

            for c in trajectory.points:
                configurations.append(
                    robot.merge_group_with_full_configuration(c, trajectory.start_configuration, group)
                )
                frame = robot.forward_kinematics(c, group, options=dict(solver="model"))
                planes.append(draw_frame(frame))
                positions.append(c.positions)
                velocities.append(c.velocities)
                accelerations.append(c.accelerations)

            start_configuration = trajectory.start_configuration
            fraction = trajectory.fraction
            time = trajectory.time_from_start

        P = list_to_ghtree(list(zip(*positions)))
        V = list_to_ghtree(list(zip(*velocities)))
        A = list_to_ghtree(list(zip(*accelerations)))

        # return outputs if you have them; here I try it for you:
        return (start_configuration, configurations, fraction, time, planes, P, V, A)
# ---------- end trajectory_visualize ----------
number_slider = Slider(187, range=0..187)
list_item_14 = ListItem(List=trajectory_visualize.configurations, Index=number_slider, Wrap=True)
list_item_15 = ListItem(List=trajectory_visualize.planes, Index=number_slider, Wrap=True)
robot_visualize = RobotVisualize(robot=ros_robot, configuration=list_item_14)  # -> visual, collision, collision_meshes, attached_meshes, frames, base_frame, ee_frame; inputs show_visual: Boolean, show_collision: Boolean, show_frames: Boolean, show_base_frame: Boolean, show_end_effector_frame: Boolean, show_cm: Boolean, show_acm: Boolean
#   port group: The planning group used for end-effector and base visualization.
#   port configuration: The robot's full configuration.
#   port show_visual: Whether or not to show the robot's visual meshes.
#   port show_collision: Whether or not to show the robot's collision meshes.
#   port show_frames: Whether or not to show the robot's joint frames.
#   port show_base_frame: Whether or not to show the robot's base frame.
#   port show_end_effector_frame: Whether or not to show the robot's end-effector frame.
#   port show_cm: Whether or not to show the collision meshes (if any).
#   port show_acm: Whether or not to show the attached collision meshes (if any).
#   port visual: Rhino meshes of the robot's visual geometry (if any).
#   port collision: Rhino meshes of the robot's collision geometry (if any).
#   port collision_meshes: Rhino meshes of the scene's collision meshes (if any).
#   port attached_meshes: Rhino meshes of the scene's attached collision meshes (if any).
#   port frames: The robot's joint frames as Rhino planes (if any).
#   port base_frame: The robot's base frame as a Rhino plane (if any).
#   port ee_frame: The robot's end-effector frame as a Rhino plane (if any).
# ---------- robot_visualize: Python ----------
"""
Visualizes the robot.

COMPAS FAB v0.28.0
"""
import time

from compas.artists import Artist
from compas.geometry import Frame
from compas.geometry import Transformation
from ghpythonlib.componentbase import executingcomponent as component
from scriptcontext import sticky as st

from compas_fab.ghpython.components import create_id
from compas_fab.robots import PlanningScene


class RobotVisualize(component):
    def RunScript(
        self,
        robot,
        group,
        configuration,
        show_visual,
        show_collision,
        show_frames,
        show_base_frame,
        show_end_effector_frame,
        show_cm,
        show_acm,
    ):
        visual = None
        collision = None
        collision_meshes = None
        attached_meshes = None
        frames = None
        base_frame = None
        ee_frame = None

        if robot:
            show_visual = True if show_visual is None else show_visual
            show_cm = True if show_cm is None else show_cm
            show_acm = True if show_acm is None else show_acm
            configuration = configuration or robot.zero_configuration()

            robot.update(configuration, visual=show_visual, collision=show_collision)
            compas_frames = robot.transformed_frames(configuration, group)

            if show_visual:
                visual = robot.artist.draw_visual()

            if show_collision:
                collision = robot.artist.draw_collision()

            if show_base_frame:
                base_compas_frame = compas_frames[0]
                artist = Artist(base_compas_frame)
                base_frame = artist.draw()

            if show_end_effector_frame:
                ee_compas_frame = robot.forward_kinematics(configuration, group, options=dict(solver="model"))
                artist = Artist(ee_compas_frame)
                ee_frame = artist.draw()

            if show_frames:
                frames = []
                for compas_frame in compas_frames[1:]:
                    artist = Artist(compas_frame)
                    frame = artist.draw()
                    frames.append(frame)

            cached_scene_key = create_id(self, "cached_scene")

            if show_cm or show_acm:
                cached_scene = st.get(cached_scene_key)
                if not cached_scene:
                    cached_scene = {"time": 0}

                # expire cache if the component has not been executed in the last 2 seconds
                # this allows to slide through a list of configurations
                # without triggering refreshes of the scene in the middle of it
                if time.time() - cached_scene["time"] > 2:
                    update_scene = True
                else:
                    update_scene = False

                if update_scene:
                    scene = PlanningScene(robot)
                    scene = robot.client.get_planning_scene()

                if update_scene and show_cm:
                    collision_meshes = []

                    for co in scene.world.collision_objects:
                        header = co.header
                        frame_id = header.frame_id
                        cms = co.to_collision_meshes()

                        for cm in cms:
                            if cm.frame != Frame.worldXY():
                                t = Transformation.from_frame(cm.frame)
                                mesh = cm.mesh.transformed(t)
                            else:
                                mesh = cm.mesh

                            collision_meshes.append(Artist(mesh).draw())

                        cached_scene["cm"] = collision_meshes

                collision_meshes = cached_scene.get("cm", [])

                if update_scene and show_acm:
                    attached_meshes = []

                    for aco in scene.robot_state.attached_collision_objects:
                        for acm in aco.to_attached_collision_meshes():
                            frame_id = aco.object["header"]["frame_id"]
                            frame = robot.forward_kinematics(configuration, options=dict(link=frame_id))
                            t = Transformation.from_frame(frame)

                            # Local CM frame
                            if acm.collision_mesh.frame and acm.collision_mesh.frame != Frame.worldXY():
                                t = t * Transformation.from_frame(acm.collision_mesh.frame)

                            mesh = acm.collision_mesh.mesh.transformed(t)

                            attached_meshes.append(Artist(mesh).draw())

                    cached_scene["acm"] = attached_meshes

                attached_meshes = cached_scene.get("acm", [])

                cached_scene["time"] = time.time()
                st[cached_scene_key] = cached_scene

        return (
            visual,
            collision,
            collision_meshes,
            attached_meshes,
            frames,
            base_frame,
            ee_frame,
        )
# ---------- end robot_visualize ----------

# ==== cluster Cluster
curves = ClusterInput()
area = Area(Geometry=curves)  # -> Area, Centroid
deconstruct = Deconstruct(Point=area.Centroid)  # -> XComponent, YComponent, ZComponent
sort_list = SortList(Keys=deconstruct.YComponent, ValuesValuesA=curves)  # -> Keys, ValuesValuesA
explode = Explode(Curve=sort_list.ValuesValuesA, Recursive=True)  # -> Segments, Vertices
deconstruct_2 = Deconstruct(Point=explode.Vertices)  # -> XComponent, YComponent, ZComponent
sort_list_2 = SortList(Keys=deconstruct_2.YComponent, ValuesValuesA=explode.Vertices)  # -> Keys, ValuesValuesA
list_item = ListItem(List=sort_list_2.ValuesValuesA, Index=0, Wrap=True)
list_item_2 = ListItem(List=sort_list_2.ValuesValuesA, Index="-1", Wrap=True)
line = Line(StartPoint=list_item, EndPoint=list_item_2)  # -> flatten(Line)
length = Length(Curve=line)  # -> flatten(Length)
sort_list_3 = SortList(Keys=length, ValuesValuesA=line)  # -> Keys, ValuesValuesA
curve_middle = CurveMiddle(Curve=sort_list_3.ValuesValuesA)
sort_list_4 = SortList(Keys=length, ValuesValuesA=sort_list.ValuesValuesA)  # -> Keys, ValuesValuesA
sort_list_5 = SortList(Keys=length, ValuesValuesA=length)  # -> Keys, ValuesValuesA
xy_plane = XYPlane(Origin=curve_middle)
curves_2 = ClusterOutput(sort_list_4.ValuesValuesA)
lenghts = ClusterOutput(sort_list_5.ValuesValuesA)
frames = ClusterOutput(xy_plane)
