# Grasshopper definition test.gh (Grasshopper 1.0.7)

ghpython_script = GhPythonScript()  # -> out, a
# ---------- ghpython_script: Python ----------
from compas.geometry import Point, Frame
from compas.data import json_dumps, json_loads

pt = Point(2,3,5)
frame = Frame.worldXY()

list_rand = [pt,frame]
result = json_dumps(list_rand)

print(pt.data)
print(frame.data)
print(result)
# ---------- end ghpython_script ----------
version_checker = GhPythonScript()  # -> out, a
# ---------- version_checker: Python ----------
import compas_urt

print(compas_urt.__version__)
# ---------- end version_checker ----------
info = Info()  # -> info
#   port info: Environment info.
# ---------- info: Python ----------
"""
Displays information about the active COMPAS environment.
"""
import compas_bootstrapper
from ghpythonlib.componentbase import executingcomponent as component

import compas


class CompasInfo(component):
    def RunScript(self):
        self.Message = "COMPAS v{}".format(compas.__version__)
        info = "COMPAS Version: {}\nEnvironment: {}"
        return info.format(compas.__version__, compas_bootstrapper.ENVIRONMENT_NAME)
# ---------- end info ----------
panel = Panel(info)
