# Grasshopper definition tile-design_professor.gh (Grasshopper 1.0.7)
# plug-ins: Kangaroo2 Components

ghpython_script = GhPythonScript(reset=Button())
# ---------- ghpython_script: Python ----------
if reset:
    from compas_urt.ghpython.dev import reload_urt_modules
    reload_urt_modules()
# ---------- end ghpython_script ----------

# ----
# seed
seed = Slider(7, range=0..100)
ghpython_script_2 = GhPythonScript(seed=seed)  # -> seed
# ---------- ghpython_script_2: Python ----------
import random
random.seed(seed)
# ---------- end ghpython_script_2 ----------
seed_2 = Data(ghpython_script_2)

# ---- group: Surfaces
# surfaces
curves = Curve([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])
loft = Loft(Curves=curves, Options={Adjust=False, Closed=False, LoftEnds=0, LoftSimp=0, LoftType=0, Rebuild=10, Refit=0.01})
demo_surface = Surface(reparameterize(loft))
selected_surface = Surface(demo_surface)

# ----
# surface preview
selected_surface_2 = Surface(selected_surface)
custom_preview = CustomPreview(Geometry=selected_surface_2, Material=ColourSwatch(SwatchColor=RGB(227, 227, 227)))

# ----
# tile
# parameters
# in mm
# diameter
# thickness
# joint
thickness = Slider(3, range=0.1..10)
tile_joint_mm = Slider(5, range=-20..20)
tile_a = Panel("19")
tile_b = Panel("28")
tile_c = Panel("33")
tile_d = Panel("45.5")

# ----
# tile
# parameters
# in m
# diameter
# thickness
# joint
merge = Merge(Data1=tile_a, Data2=tile_b, Data3=tile_c, Data4=tile_d)
division = Division(A=merge, B="1000")
division_2 = Division(A=thickness, B="1000")
division_3 = Division(A=tile_joint_mm, B="1000")
list_item = ListItem(List=division, Index=0, Wrap=True)  # -> Item, Item1, Item2, Item3
tile_a_diameter = Number(list_item.Item)
tile_b_diameter = Number(list_item.Item1)
tile_c_diameter = Data(list_item.Item2)
tile_d_diameter = Data(list_item.Item3)
tile_thickness = Data(division_2)
tile_joint = Data(division_3)

tile_joint_mm_2 = Slider(0, range=0..10)
selected_surface_3 = Surface(selected_surface)
tile_thickness_2 = Data(tile_thickness)
tile_thickness_3 = Data(tile_thickness)
merge_2 = Merge(Data1="0.07", Data2="0.020")
merge_3 = Merge(Data1=tile_thickness_3, Data2=tile_thickness_2)
effect_factor = Slider(1.2, range=0..10)
division_num = Slider(50, range=0..500)
division_4 = Division(A=tile_joint_mm_2, B="1000")
tile_joint_2 = Data(division_4)
curve = Curve(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)
seed_3 = Data(ghpython_script_2)

shift_min_max_edge_isocurve = BooleanToggle(False)
curve_density = Slider(1, range=1..20)
reverse_curve_params = BooleanToggle(False)
pack_type = ValueList({"hexagonal", "aligned"}, selected="hexagonal")
curve_type = ValueList({"contours", "isocurves"}, selected="isocurves")
flip_curves = BooleanToggle(False)
flip_frame = BooleanToggle(False)
uniform = BooleanToggle(True)
selected_surface_4 = Surface(selected_surface)
input_curve = Curve(reparameterize(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))
seed_4 = Data(ghpython_script_2)

# ----
# Altering layers
active = BooleanToggle(False)

merge_4 = Merge(
    Data1=ColourSwatch(SwatchColor=RGB(0, 0, 0)),
    Data2=ColourSwatch(SwatchColor=RGB(156, 156, 149)),
    Data3=ColourSwatch(SwatchColor=RGB(247, 242, 242)))
available_colors = Data(merge_4)

# ----
# 1) ImageLayer Instance
selected_surface_5 = Surface(selected_surface)

# ----
# load image
select_one_existing_image_file = FilePath("C:\Users\gcasas\eth\Workshops\workshop_iaac_2024\images\imagelayer_checker500x100.png")
load_image = GhPythonScript(image_path=select_one_existing_image_file)  # -> image, width, height
# ---------- load_image: Python ----------
#from compas_urt.ghpython.dev import reload_urt_modules
#reload_urt_modules()

from compas_urt.design.load_image import LoadedImage

image = LoadedImage(image_path)
print(image)
width = image.width
height = image.height
# ---------- end load_image ----------
panel = Panel(load_image.width)
panel_2 = Panel(load_image.height)
resize = Slider(2.5, range=0..10)
division_5 = Division(A=[panel, panel_2], B=resize)
integer = Integer(division_5)
list_item_2 = ListItem(List=integer, Index=0, Wrap=True)  # -> Item, Item1

merge_5 = Merge(
    Data1=ColourSwatch(SwatchColor=RGB(0, 0, 0)),
    Data2=ColourSwatch(SwatchColor=RGB(156, 156, 149)),
    Data3=ColourSwatch(SwatchColor=RGB(247, 242, 242)))
available_colors_2 = Data(merge_5)

# ----
# 1) GridLayer Instance
tile_b_diameter_2 = Number(tile_b_diameter)
thickness_2 = Number(tile_thickness)
tile_joint_3 = Number(tile_joint)
# Generative layers
gridlayer = GhPythonScript(
    surface=selected_surface_4,
    uniform=uniform,
    pack_type=pack_type,
    curve_type=curve_type,
    flip_curves=flip_curves,
    flip_frame=flip_frame,
    reverse_curve_params=reverse_curve_params,
    shift_min_max_edge_isocurve=shift_min_max_edge_isocurve,
    tile_diameter=tile_b_diameter_2,
    thickness=thickness_2,
    tile_joint=tile_joint_3,
    param_density=curve_density,
    input_curves=input_curve,
    seed=seed_4)  # -> tiles, grid_layer, base_frames, pickup_frames, curves; inputs surface: Brep, input_curves: list of Curve
# ---------- gridlayer: Python ----------
#from compas_urt.ghpython.dev import reload_urt_modules
#reload_urt_modules()

from copy import deepcopy

from compas.geometry import Translation

from compas_rhino.conversions import RhinoSurface
from compas_rhino.conversions import RhinoPlane
from compas_rhino.conversions import RhinoCurve
    
from compas_urt.design import TileDesign
from compas_urt.design.generative import GridLayer



#===============================================================================
debug = []


options = {}
options["uniform"] = uniform
options["pack_type"] = pack_type
options["param_density"] = param_density
options["flip_curves"] = flip_curves
options["flip_frame"] = flip_frame
options["curve_type"] = curve_type
options["reverse_curve_params"] = reverse_curve_params
options["shift_min_max_edge_isocurve"] = shift_min_max_edge_isocurve



if curve_type == "contours":
    compas_input_curves = []
    for input_curve  in input_curves:
        compas_input_curve = RhinoCurve.from_geometry(input_curve).to_compas()
        compas_input_curves.append(compas_input_curve)
        options["input_curves"] = compas_input_curves

    
if curve_type == "isocurves":
    pass
    
if curve_type == "radial":
    pass
    
if curve_type == "tween":
    pass
    
if curve_type == "offset":
    pass
    

grid_layer = GridLayer(surface, tile_diameter, thickness, tile_joint, options = options)
grid_layer.generate()

if curve_type == "contours":
    curves = grid_layer.compas_contours
    debug.append(grid_layer.contour_frames)
if curve_type == "isocurves":
    curves = grid_layer.isocurves
    debug.append(grid_layer.edge_isocurve)
if curve_type == "radial":
    pass
if curve_type == "tween":
    pass
if curve_type == "offset":
    pass

tiles = grid_layer.tiles
base_frames = [tile.base_frame for tile in grid_layer.tiles]
pickup_frames = [tile.pickup_frame for tile in grid_layer.tiles]
debug.append(grid_layer.compas_surface)
# ---------- end gridlayer ----------
v_edge_isocurve = Draw(cg=gridlayer.tiles)  # -> rg; inputs cg: list
#   port cg: The COMPAS geometry or datastructure to be drawn.
#   port rg: The Rhino geometry object.
# ---------- v_edge_isocurve: Python ----------
"""
Draws COMPAS geometry in Grasshopper.
"""
from ghpythonlib.componentbase import executingcomponent as component

from compas.artists import Artist


class CompasToRhinoGeometry(component):
    def RunScript(self, cg):
        if not cg:
            return None

        artist = Artist(cg[0])
        print(dir(artist))
        rg = []
        for i in cg:
            artist.round_tile = i
            rg.append(artist.draw())
        return rg
# ---------- end v_edge_isocurve ----------
grid_layer = Data(gridlayer.grid_layer)
v_edge_isocurve_2 = Draw(cg=gridlayer.base_frames)  # -> rg; inputs cg: list; disabled
#   port cg: The COMPAS geometry or datastructure to be drawn.
#   port rg: The Rhino geometry object.
# ---------- v_edge_isocurve_2: Python ----------
"""
Draws COMPAS geometry in Grasshopper.
"""
from ghpythonlib.componentbase import executingcomponent as component

from compas.artists import Artist


class CompasToRhinoGeometry(component):
    def RunScript(self, cg):
        if not cg:
            return None

        artist = Artist(cg[0])
        print(dir(artist))
        rg = []
        for i in cg:
            artist.primitive = i
            rg.append(artist.draw())
        return rg
# ---------- end v_edge_isocurve_2 ----------
v_edge_isocurve_3 = Draw(cg=gridlayer.pickup_frames)  # -> rg; inputs cg: list; disabled; same code as v_edge_isocurve_2
v_edge_isocurve_4 = Draw(cg=gridlayer.curves)  # -> rg; inputs cg: list
#   port cg: The COMPAS geometry or datastructure to be drawn.
#   port rg: The Rhino geometry object.
# ---------- v_edge_isocurve_4: Python ----------
"""
Draws COMPAS geometry in Grasshopper.
"""
from ghpythonlib.componentbase import executingcomponent as component

from compas.artists import Artist


class CompasToRhinoGeometry(component):
    def RunScript(self, cg):
        if not cg:
            return None

        artist = Artist(cg[0])
        print(dir(artist))
        rg = []
        for i in cg:
            artist.curve = i
            rg.append(artist.draw())
        return rg
# ---------- end v_edge_isocurve_4 ----------
custom_preview_2 = CustomPreview(Geometry=v_edge_isocurve, Material=ColourSwatch(SwatchColor=RGB(66, 66, 66)))  # disabled

# ----
# 3) AttractorsLayer Instance
selected_surface_6 = Surface(selected_surface)
layer = Data(grid_layer)
attractor_curves = Curve(reparameterize([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]))
effect_factor_m = Slider(0.405, range=0..5)
seed_5 = Data(ghpython_script_2)
attractorslayer = GhPythonScript(surface=selected_surface_6, layer=layer, input_curves=attractor_curves, effect_factor=effect_factor_m, seed=seed_5)  # -> out, affected_tiles, non_affected_tiles; inputs surface: Brep, input_curves: list of Curve
# ---------- attractorslayer: Python ----------
from compas_urt.design.altering import AttractorsLayer
from compas_rhino.conversions import RhinoCurve
import random
random.seed(seed)

compas_input_curves = []
for input_curve  in input_curves:
    compas_input_curve = RhinoCurve.from_geometry(input_curve).to_compas()
    compas_input_curves.append(compas_input_curve)


attractors_layer = AttractorsLayer(surface)

affected_tiles_indices = []
for curve_index, compas_input_curve in enumerate(compas_input_curves):
    affected_tiles_indices_per_curve, distances = attractors_layer.get_affected_tiles_and_distances_single_curve(layer, compas_input_curve, effect_factor)
    for tile_index in affected_tiles_indices_per_curve:
        if random.random() <= (curve_index + 0.5) / len(compas_input_curves):
            affected_tiles_indices.append(tile_index)

affected_tiles = []
non_affected_tiles = []
affected_tiles_set = set(affected_tiles_indices)
for tile_index, tile in enumerate(layer.tiles):
    if tile_index not in affected_tiles_set:
        non_affected_tiles.append(layer.tiles[tile_index])
    else:
        affected_tiles.append(layer.tiles[tile_index])
# ---------- end attractorslayer ----------
v_edge_isocurve_5 = Draw(cg=attractorslayer.affected_tiles)  # -> rg; inputs cg: list; same code as v_edge_isocurve
v_edge_isocurve_6 = Draw(cg=attractorslayer.non_affected_tiles)  # -> rg; inputs cg: list; same code as v_edge_isocurve
custom_preview_3 = CustomPreview(Geometry=v_edge_isocurve_5, Material=ColourSwatch(SwatchColor=RGB(74, 74, 74)))  # disabled
custom_preview_4 = CustomPreview(Geometry=v_edge_isocurve_6, Material=ColourSwatch(SwatchColor=RGB(255, 255, 255)))  # disabled

# ----
# 2) TileBrushLayer Instance
tilebrushlayer = GhPythonScript(
    surface=selected_surface_3,
    tile_diameter=merge_2,
    tile_thickness=merge_3,
    tile_joint=tile_joint_2,
    input_curve=curve,
    effect_factor=effect_factor,
    division_num=division_num,
    seed=seed_3)  # -> tiles, tile_brush_layer; inputs surface: Brep, tile_diameter: list, tile_thickness: list, input_curve: Curve
# ---------- tilebrushlayer: Python ----------
#from compas_urt.ghpython.dev import reload_urt_modules
#reload_urt_modules()

import math as m
import random
random.seed(seed)

from scriptcontext import sticky as stk

from compas_rhino.conversions import RhinoSurface
from compas_rhino.conversions import plane_to_rhino
from compas_rhino.conversions import RhinoPlane
from compas_rhino.conversions import frame_to_rhino
from compas_rhino.conversions import RhinoCurve
from compas_rhino.conversions import ellipse_to_rhino
from compas_rhino.conversions import vector_to_rhino

from compas.artists import Artist

from compas.utilities import linspace

from compas.geometry import Frame, Vector, Point, Plane
from compas.geometry import Circle, Cylinder

from compas_rhino.geometry import RhinoNurbsCurve, RhinoCurve, RhinoNurbsSurface

import Rhino.Geometry as rg

from compas_urt.design import TileDesign
from compas_urt.design.generative import GridLayer
from compas_urt.design.generative import TileBrushLayer


#===============================================================================

if len(tile_diameter) != len(tile_thickness):
    raise Exception("The number of thicknesses should match the number of tile diameters")

compas_input_curve = RhinoCurve.from_geometry(input_curve).to_compas()

brush_strokes = TileBrushLayer(surface,
                                compas_input_curve,
                                division_num,
                                tile_joint,
                                tile_diameter,
                                tile_thickness,
                                effect_factor)

brush_strokes.generate()
tiles = brush_strokes.tiles
_, collisions_count = brush_strokes.get_motion_vectors()


tile_brush_layer = brush_strokes
# ---------- end tilebrushlayer ----------
v_edge_isocurve_7 = Draw(cg=tilebrushlayer.tiles)  # -> rg; inputs cg: list; same code as v_edge_isocurve
tile_brush_layer_tiles = Data(tilebrushlayer.tiles)
tile_brush_layer = Data(tilebrushlayer.tile_brush_layer)
custom_preview_5 = CustomPreview(Geometry=v_edge_isocurve_7, Material=ColourSwatch(SwatchColor=RGB(66, 66, 66)))  # disabled

# ----
# Combine layers
top_layer = Data(tile_brush_layer)
bottom_layer = Data(grid_layer)
combine_layers = GhPythonScript(top_layer=top_layer, bottom_layer=bottom_layer)  # -> top_layer_tiles, bottom_layers_tiles, all_tiles
# ---------- combine_layers: Python ----------
from compas_urt.design import TileDesign

tile_design = TileDesign()
top_layer, bottom_layer = tile_design.combine_layers(top_layer, bottom_layer)
#tile_design.combine_layers(top_layer, bottom_layer)


top_layer_tiles = top_layer.tiles
bottom_layers_tiles = bottom_layer.tiles

all_tiles = top_layer_tiles + bottom_layers_tiles
# ---------- end combine_layers ----------
v_edge_isocurve_8 = Draw(cg=combine_layers.top_layer_tiles)  # -> rg; inputs cg: list; same code as v_edge_isocurve
v_edge_isocurve_9 = Draw(cg=combine_layers.bottom_layers_tiles)  # -> rg; inputs cg: list; same code as v_edge_isocurve
combined_tiles = Data(combine_layers.all_tiles)
v_edge_isocurve_10 = Draw(cg=combined_tiles)  # -> rg; inputs cg: list; same code as v_edge_isocurve
custom_preview_6 = CustomPreview(Geometry=v_edge_isocurve_8, Material=ColourSwatch(SwatchColor=RGB(0, 0, 0)))  # disabled
custom_preview_7 = CustomPreview(Geometry=v_edge_isocurve_9, Material=ColourSwatch(SwatchColor=RGB(255, 0, 0)))  # disabled

# ----
# debug_KDTree
point = Point(<point referenced from the Rhino model>)  # disabled
debug_kdtree = GhPythonScript(bottom_layer=bottom_layer, test_pt=point)  # -> out, neighbor_tiles; inputs test_pt: Point3d; disabled
# ---------- debug_kdtree: Python ----------
from compas.geometry import KDTree

bottom_tiles = bottom_layer.tiles

tiles_bottom_centers = [tile_bottom.base_frame.point for tile_bottom in bottom_layer.tiles]
kdtree = KDTree(tiles_bottom_centers)


nearest_neighbors = kdtree.nearest_neighbors(test_pt, 15, True)
neighbor_tiles = []

for nearest_neighbor in nearest_neighbors:
    neighbor_center, neighbor_index, neighbor_dist = (
        nearest_neighbor[0],
        nearest_neighbor[1],
        nearest_neighbor[2],
    )
    

    neighbor_tiles.append(bottom_layer.tiles[neighbor_index])
# ---------- end debug_kdtree ----------
v_edge_isocurve_11 = Draw(cg=debug_kdtree.neighbor_tiles)  # -> rg; inputs cg: list; disabled; same code as v_edge_isocurve

# ----
# assign colors to tiles
grid_layer_2 = Data(grid_layer)
flip_frame_2 = BooleanToggle(True)
available_colors_3 = Data(available_colors_2)
return_meshes = BooleanToggle(False)
active_2 = BooleanToggle(False)
imagelayer = GhPythonScript(
    loaded_image=load_image.image,
    surface=selected_surface_5,
    layer=grid_layer_2,
    flip_frame=flip_frame_2,
    available_colors=available_colors_3,
    nu=list_item_2.Item,
    nv=list_item_2.Item1,
    return_meshes=return_meshes,
    active=active_2)  # -> out, tiles, quads_meshes, tile_colors; inputs surface: Brep, available_colors: list, nu: Int32, nv: Int32
# ---------- imagelayer: Python ----------
from compas_urt.design.altering import ImageLayer
from System.Drawing import Color

if active:
    image_layer = ImageLayer(surface, loaded_image)
    copied_layer = image_layer.alter(layer, nu, nv, flip_frame, available_colors, return_meshes)
    tiles = copied_layer.tiles
    
    
    tile_colors = []
    for tile in tiles:
        r, g, b, a = tile.color.rgba255
        rhino_color = Color.FromArgb(a, r, g, b)
        tile_colors.append(rhino_color)
    
    
    if return_meshes:
        quads_meshes = image_layer.meshes
# ---------- end imagelayer ----------
v_edge_isocurve_12 = Draw(cg=imagelayer.tiles)  # -> rg; inputs cg: list; same code as v_edge_isocurve
draw = COMPASDraw(meshes=imagelayer.quads_meshes)  # -> rg; inputs meshes: list
#   port meshes: The COMPAS geometry or datastructure to be drawn.
# ---------- draw: Python ----------
from compas.artists import Artist
from compas.colors import Color

if meshes and meshes[0] is not None:
    artist = Artist(meshes[0])
    rg = []
    
    for mesh in meshes:
        artist.mesh = mesh
        print mesh.attributes["color"]
        rg.append(artist.draw(color=mesh.attributes["color"]))
# ---------- end draw ----------
mesh = Mesh(v_edge_isocurve_12)  # disabled
custom_preview_8 = CustomPreview(Geometry=mesh, Material=imagelayer.tile_colors)  # disabled

# ----
# AddTileLayer Instance
tile_a_diameter_2 = Number(tile_a_diameter)  # disabled
flip_frame_3 = BooleanToggle(True)  # disabled
selected_surface_7 = Surface(selected_surface)  # disabled
points = Point()  # disabled
thickness_3 = Number(tile_thickness)  # disabled
addtilelayer = GhPythonScript(
    rhino_brep=selected_surface_7,
    points=points,
    tile_diameter=tile_a_diameter_2,
    tile_thickness=thickness_3,
    flip_frame=flip_frame_3)  # -> out, tile, layer; inputs rhino_brep: Brep, points: list of Point3d; disabled
# ---------- addtilelayer: Python ----------
from compas_urt.design.generative import AddTileLayer
from compas_rhino.conversions import point_to_compas

options = {}
options["flip_frame"] = flip_frame
    
add_tile_layer = AddTileLayer(rhino_brep, points, tile_diameter, tile_thickness, options=options)
add_tile_layer.generate()

tile = add_tile_layer.tiles
layer = add_tile_layer
# ---------- end addtilelayer ----------
v_edge_isocurve_13 = Draw(cg=addtilelayer.tile)  # -> rg; inputs cg: list; disabled; same code as v_edge_isocurve
tile = Data(addtilelayer.tile)  # disabled
add_tile_layer = Data(addtilelayer.layer)  # disabled

# ----
# Kangaroo packing
flip_frame_4 = BooleanToggle(False)
tiles = Data(combined_tiles)
tile_joint_4 = Number(tile_joint)
selected_surface_8 = Surface(selected_surface)
division_6 = Division(A=tile_joint_4, B="2")
evaluate_tiles = GhPythonScript(tiles=tiles, factor=division_6)  # -> points, radii, planes; inputs tiles: list
# ---------- evaluate_tiles: Python ----------
from compas_rhino.conversions import point_to_rhino, frame_to_rhino_plane

points = []
radii = []
planes = []

for tile in tiles:
    points.append(point_to_rhino(tile.base_frame.point))
    planes.append(frame_to_rhino_plane(tile.base_frame))
    radii.append((tile.diameter / 2) + factor)
# ---------- end evaluate_tiles ----------
active_3 = BooleanToggle(False)
tiles_2 = Data(tiles)

# ---- group: Goals for Kangaroo
collider = Collider(Objects=evaluate_tiles.points, Radii=evaluate_tiles.radii, Strength=1)
mesh_brep = MeshBrep(
    Brep=selected_surface_8,
    Settings={GridMaxCount=0, GridMinCount=16, JaggedSeams=False, MaxEdgeLength=0, MinEdgeLength=0.0001, MinTolerance=0, Refine=True, RefineAngle=0, RelativeTolerance=0.65, SimplePlanes=True, Tolerance=0})
onmesh = OnMesh(Points=evaluate_tiles.points, Mesh=mesh_brep, Strength=1)

# ----
# 2) CurvatureAlteringLayer
selected_surface_9 = Surface(selected_surface)
value_list = ValueList({"sin_gaussian", "sin_mean", "mean", "exp_sin_curv", "exp_sin_of_u_param", "exp_sin_of_v_param", "exp_sin_of_uv_param", "exp_sin_of_uv_param_random"}, selected="exp_sin_of_uv_param")

solver = Solver(GoalObjects=flatten([onmesh, collider]), Reset=Button(), Threshold=1e-15, Tolerance=0.0001, On=active_3)  # -> I, V, O

# ---- group: Recreate packed tiles
surface = Surface(selected_surface_8)
surface_closest_point = SurfaceClosestPoint(Point=solver.V, Surface=surface)  # -> Point, UVPoint, Distance
evaluate_surface = EvaluateSurface(Surface=surface, Point=surface_closest_point.UVPoint)  # -> Point, Normal, UDirection, VDirection, Frame
ghpython_script_3 = GhPythonScript(frames=evaluate_surface.Frame, tiles=tiles_2, flip_frame=flip_frame_4, surface=surface)  # -> packed_tiles, new_layer, tile_colors; inputs frames: list of Plane, tiles: list, surface: Brep
# ---------- ghpython_script_3: Python ----------
#from compas_rhino.conversions import point_to_compas
from compas_rhino.conversions import plane_to_compas_frame
from compas_urt.design import RoundTile
from compas_urt.design import DesignLayer
from System.Drawing import Color

packed_tiles = []

for tile, rhino_plane in zip(tiles, frames):

    frame = plane_to_compas_frame(rhino_plane)
    if flip_frame:
        frame.xaxis *= -1
    
    packed_tile = RoundTile(base_frame=frame, diameter=tile.diameter, thickness=tile.thickness, uv_param=tile.uv_param, color=tile.color)
    packed_tiles.append(packed_tile)
    
    
    
new_layer = DesignLayer(surface)
new_layer.tiles = packed_tiles




tile_colors = []
for tile in packed_tiles:
    r, g, b, a = tile.color.rgba255
    rhino_color = Color.FromArgb(a, r, g, b)
    tile_colors.append(rhino_color)
# ---------- end ghpython_script_3 ----------
v_edge_isocurve_14 = Draw(cg=ghpython_script_3.packed_tiles)  # -> rg; inputs cg: list; same code as v_edge_isocurve
packed_tiles = Data(ghpython_script_3.packed_tiles)
new_layer = Data(ghpython_script_3.new_layer)

# ----
layer_2 = Data(new_layer)
curvature_altering_layer = GhPythonScript(
    surface=selected_surface_9,
    layer=layer_2,
    effect_type=value_list,
    factor=Slider(-16.51, range=-50..3),
    exponent=Slider(1.02, range=-3..3),
    active=active,
    available_colors=available_colors)  # -> curvatures; inputs surface: Brep, available_colors: list
# ---------- curvature_altering_layer: Python ----------
import math
import random
from copy import copy
from compas.colors import Color
from compas.colors import ColorMap
from compas.geometry import KDTree

from compas_urt.design.altering import AltLayer

import System.Drawing as sd


class CurvatureAlteringLayer(AltLayer):
    def alter(self, layer, effect_type="sin_gaussian"):
        curvature_values = []
            
        for tile in layer.tiles:
            curvature = self.rhino_brep.Faces[0].CurvatureAt(*tile.uv_param)
            if curvature:
                if effect_type == "sin_gaussian":
                    effect = math.sin(curvature.Gaussian)
                elif effect_type == "sin_mean":
                    effect = math.sin(curvature.Mean)
                elif effect_type == "mean":
                    effect = curvature.Mean
                elif effect_type == "exp_sin_curv":
                    effect = math.pow(((math.sin(factor * curvature.Gaussian) + 1) / 2), exponent)
                elif effect_type == "exp_sin_of_u_param":
                    effect = math.pow(((math.sin(factor * tile.uv_param[0]) + 1) / 2), exponent)
                elif effect_type == "exp_sin_of_v_param":
                    effect = math.pow(((math.sin(factor * tile.uv_param[1]) + 1) / 2), exponent)
                elif effect_type == "exp_sin_of_uv_param":
                    effect = math.pow(((math.sin(factor * (tile.uv_param[0] + tile.uv_param[1])) + 1) / 2), exponent)
                elif effect_type == "exp_sin_of_uv_param_random":
                    effect = math.pow(math.sin((factor * random.random() * (tile.uv_param[0] + tile.uv_param[1])) + 1) / 2, exponent)
                else:
                    raise("Invalid selection!")
                curvature_values.append(effect)
        
        return curvature_values 

if active:
    curvature_layer = CurvatureAlteringLayer(surface)
    curvatures = curvature_layer.alter(layer, effect_type)
    max_curvature = max(curvatures)
    min_curvature = min(curvatures)
    
    print curvatures.index(max_curvature)
    print curvatures.index(min_curvature)
    
    print "min", min_curvature
    print "max", max_curvature
# ---------- end curvature_altering_layer ----------
gradient = Gradient(
    LowerLimit=0,
    UpperLimit=1,
    Parameter=curvature_altering_layer,
    stops=[0.235: RGB(255, 255, 255), 0.661: RGB(192, 192, 192)])
tiles_3 = Data(v_edge_isocurve_14)
mesh_2 = Mesh(tiles_3)
custom_preview_9 = CustomPreview(Geometry=mesh_2, Material=gradient)

custom_preview_10 = CustomPreview(Geometry=v_edge_isocurve_14, Material=ColourSwatch(SwatchColor=RGB(54, 54, 54)))  # disabled
